# Grasshopper definition latlon2.gh (Grasshopper 1.0.7)

download_osm = BooleanToggle(False)
file_path = FilePath("C:\Users\ssanjay\Desktop\")
bbox = Panel("250")
ghpython_script = GhPythonScript(search="doktor forselius backe 11, gothenburg", bbox=bbox, path=file_path, run=download_osm)  # -> out, filePath; inputs bbox: Int32, run: Boolean
# ---------- ghpython_script: Python ----------
#This script downloads an OSM file and saves it to drive from a center point or a search term
#Input Varaiable
#   search  - [string]              Search query of the location
#   midLat  - [float]   (optional)  latitude of the building
#   midLon  - [float]   (optional)  longitude of the building
#   bbox    - [int]                 Dimension of one side of bounding box for OSM
#   path    - [string]              A folder directory to save the OSM File  
#   run     - [boolean]             A boolean toggle to download the OSM file (Run once)

__author__ = "ssanjay"
__version__ = "2020.07.31"

import xml.etree.ElementTree as ET
import ghpythonlib.treehelpers as th
import math
import urllib2
import json

#The following key is my personal key, if there are large requests expected
#it's probably better to generate a more robust account

KEY = '4b10f1ba1be313b7d36ca7a65836fe52'

#Creates option to either search or use manual midLat and midLon
if search:
    print 'Search Tag found' 
    query = search.replace(" ", "%20")
    url = 'http://api.positionstack.com/v1/forward?access_key='+KEY+'&query='+query
    response = urllib2.urlopen(url)
    data = json.load(response)   
    midLon = data['data'][0]['longitude']
    midLat = data['data'][0]['latitude']
else:
    print 'Search Tag not Found. Enter search term or use midLat and midLon'

#Constants for calculating the bounding box
R = 6371000

#Bounding Box calculation

# 111110 is the distance of 1 degree in meters for the Y direction (Latitude)
# X distance per degree = [cosine(latitude)*Y distance in radians]
#bbox here is the dimension of the boundarybox side
dY = (bbox/2) / 111110
dX = dY / math.cos(math.radians(midLat))

#Calculation the extents of the bounding box
a = str(midLon - dX)
b = str(midLat - dY)
c = str(midLon + dX)
d = str(midLat + dY)
bbox = a +','+ b + ',' + c + ',' + d

#Requesting OSM file from OverpassAPI
url = 'https://overpass-api.de/api/map?bbox='+bbox
if run:
    response = urllib2.urlopen(url)
    filePath = path+'file.osm'
    mydata = response.read()
    file = open(filePath, "w")
    file.write(mydata)
    file.close()
else:
    filePath = path+'file.osm'
# ---------- end ghpython_script ----------
ghpython_script_2 = GhPythonScript(filePath=ghpython_script.filePath)  # -> out, Boundary, Points
# ---------- ghpython_script_2: Python ----------
__author__ = "ssanjay"
__version__ = "2020.07.30"

import rhinoscriptsyntax as rs
import xml.etree.ElementTree as ET
import ghpythonlib.treehelpers as th
import math

tree = ET.parse(filePath)
root = tree.getroot()
lat = []
lon = []

#Constants
R = 6371000

# Parse Lat Lon
for element in root.findall('node'):
    lat.append(float(element.get('lat')))
    lon.append(float(element.get('lon')))

#Parse Bounds
for element in root.findall('bounds'):
    minlat = float(element.get('minlat'))
    minlon = float(element.get('minlon'))
    maxlat = float(element.get('maxlat'))
    maxlon = float(element.get('maxlon'))

#Find midpoint (Center of Bounding Box)
midlat = (minlat+maxlat)/2
midlon = (minlon+maxlon)/2

#Calculate distance per degree
ydistperdegree = (math.pi*R)/180
xdistperdegree = ((math.cos(midlat*(math.pi/180))*R)*(math.pi/180))

#Calculate x and y component
x_comp = []
y_comp = []
for i in lon:
    x_comp.append((i-minlon)*xdistperdegree)
for i in lat:
    y_comp.append((i-minlat)*ydistperdegree)
Points = []
for i in range(len(x_comp)):
    Points.append(rs.CreatePoint(x_comp[i],y_comp[i],0))

#Create boundary rectangle
plane = rs.WorldXYPlane()
Boundary = rs.AddRectangle(plane,((maxlon-minlon)*xdistperdegree),((maxlat-minlat)*ydistperdegree))


#nodeRef = []
#for element in root.findall('node'):
#    nodeRef.append(element.get('id'))

#reference = []
#chunks = []
#for way in tree.findall('way'):
#    chunks.append(len(way.findall('nd')))
#    for nd in way.findall('nd'):
#        reference.append(nd.get('ref'))
#reference = th.list_to_tree([reference[sum(chunks[:i]):sum(chunks[:i])+n] for i,n in enumerate(chunks)])
# ---------- end ghpython_script_2 ----------
panel = Panel(ghpython_script_2.Points)
